# Requirement set Requirements (R2019b)

## 1 [3] Autonomous Flight
The UAV shall be able to fly a preprogrammed course without pilot intervention.

## 2 [1] Payload Data Rate1
The UAV shall support a payload data rate out of up to 150 Mb/s.

## 3 [4] Payload Mass
The UAV shall support a payload mass of up to 50 kg.

### 3.1 [4.1] Maximum Mass
Maximum Mass is 50 kg

### 3.2 [4.2] Minimum Mass
Minimum Mass is 0 kg

## 4 [4.1] Maximum Mass
Maximum Mass is 50 kg

## 5 [4.2] Minimum Mass
Minimum Mass is 0 kg

## 6 [2] Payload Power Demand
The UAV shall support a payload power demand of up to 1 kW.